# Dynamo custom node GetTinSurfaceVolume.dyf "GetSurfaceVolume" (Dynamo 2.4.1.6326)
# category: MN_Civil3DToolkit
# Get the volume of a surface given the name

Surface_Name = Input(Surface_Name: string = "surface")
get_volume = Python(IN[0]=Surface_Name)  # graph output
# ---------- get_volume.python (95 lines) ----------
#Get Corridor ID

__author__ = 'Jesus A Duran - jduran@moffattnichol.com'
__version__ = '0.0.0'

# Load the Python Standard and DesignScript Libraries
import sys
import clr

# Add Assemblies for AutoCAD and Civil3D
clr.AddReference('AcMgd')
clr.AddReference('AcCoreMgd')
clr.AddReference('AcDbMgd')
clr.AddReference('AecBaseMgd')
clr.AddReference('AecPropDataMgd')
clr.AddReference('AeccDbMgd')
clr.AddReference('AeccPressurePipesMgd')
clr.AddReference('acdbMgdbRep')

# Create an alias to the Autodesk.AutoCAD.ApplicationServices.Application class
import Autodesk.AutoCAD.ApplicationServices.Application as acapp

# Import references from AutoCAD
from Autodesk.AutoCAD.Runtime import *
from Autodesk.AutoCAD.ApplicationServices import *
from Autodesk.AutoCAD.EditorInput import *
from Autodesk.AutoCAD.DatabaseServices import *
from Autodesk.AutoCAD.Geometry import *

# Import references for PropertySets
from Autodesk.Aec.PropertyData import *
from Autodesk.Aec.PropertyData.DatabaseServices import *

# Import references from Civil3D
from Autodesk.Civil.ApplicationServices import *
from Autodesk.Civil.DatabaseServices import *

# The inputs to this node will be stored as a list in the IN variables.
dataEnteringNode = IN

adoc = acapp.DocumentManager.MdiActiveDocument
ed = adoc.Editor


def get_tinvolumesurface_Vol(vs_name):
	adoc = acapp.DocumentManager.MdiActiveDocument
	
	vsid = None
	
	vs_output = {}
	output = {}
	outtest = {}
	
	with adoc.LockDocument():
		with adoc.Database as db:
			with db.TransactionManager.StartTransaction() as t:
				bt = t.GetObject(db.BlockTableId, OpenMode.ForWrite)
				btr = t.GetObject(bt[BlockTableRecord.ModelSpace], OpenMode.ForWrite)
				
				for oid in btr:
					obj = t.GetObject(oid, OpenMode.ForWrite)
					if isinstance(obj, TinVolumeSurface):
						if obj.Name == vs_name:
							vsid = oid
					if vsid is not None:
						break
				
				if vsid is None:
					
					return "Surface not found"

				vs = t.GetObject(vsid, OpenMode.ForWrite)
				vs.Rebuild()
				volProps = vs.GetVolumeProperties()
				genProps = vs.GetGeneralProperties()
				TinProps = vs.GetTinProperties()
				#surf_analy = vs.Analysis.GetElevationData()
				#props = vs.GetTerrainProperties()
				
				for a in dir(volProps):
					try:
						vs_output[a] = getattr(volProps, a)
					except:
						pass
				t.Commit()
				output["Cut Factor"] = vs_output["CutFactor"]
				output["Fill Factor"] = vs_output["FillFactor"]
				#output["2d Area"] = vs_output["CutFactor"]
				#Divides in 27 to convert to Cu. Yards
				output["Adjusted Cut"] = vs_output["AdjustedCutVolume"]/27
				output["Adjusted Fill"] = vs_output["AdjustedFillVolume"]/27
				output["Adjusted Net"] = vs_output["AdjustedNetVolume"]/27
	return output

OUT = get_tinvolumesurface_Vol(IN[0])
# ----------------------------------------
